# Grasshopper definition 150204 Curve lines.gh (Grasshopper 0.9.14)

slider = Slider(60, range=0..100)
crv = Curve(<curve referenced from the Rhino model>)
crv_2 = Curve(<curve referenced from the Rhino model>)
crv_3 = Curve(<curve referenced from the Rhino model>)
crv_4 = Curve(<curve referenced from the Rhino model>)
amount_of_curves_as_transition = Slider(7, range=0..10)
divide = DivideCurve(Curve=crv_2, Count=slider, Kinks=False)  # -> Points, Tangents, Parameters
divide_2 = DivideCurve(Curve=crv, Count=slider, Kinks=False)  # -> Points, Tangents, Parameters
divide_3 = DivideCurve(Curve=crv_4, Count=slider, Kinks=False)  # -> Points, Tangents, Parameters
divide_4 = DivideCurve(Curve=crv_3, Count=slider, Kinks=False)  # -> Points, Tangents, Parameters
ln = Line(StartPoint=divide.Points, EndPoint=divide_3.Points)
ln_2 = Line(StartPoint=divide_3.Points, EndPoint=divide_4.Points)
ln_3 = Line(StartPoint=divide_2.Points, EndPoint=divide.Points)
distance_between_points = Slider(0.5, range=0.01..2)
divide_5 = DivideCurve(Curve=ln_3, Count=amount_of_curves_as_transition, Kinks=False)  # -> Points, Tangents, Parameters
multiplication = Multiplication(A=amount_of_curves_as_transition, B="2")
divide_6 = DivideCurve(Curve=ln, Count=amount_of_curves_as_transition, Kinks=False)  # -> Points, Tangents, Parameters
multiplication_2 = Multiplication(A=amount_of_curves_as_transition, B="2")
divide_7 = DivideCurve(Curve=ln_2, Count=amount_of_curves_as_transition, Kinks=False)  # -> Points, Tangents, Parameters
multiplication_3 = Multiplication(A=amount_of_curves_as_transition, B="2")
divide_8 = DivideCurve(Curve=ln_3, Count=multiplication, Kinks=False)  # -> Points, Tangents, Parameters
flip = FlipMatrix(Data=divide_5.Points)
divide_9 = DivideCurve(Curve=ln, Count=multiplication_2, Kinks=False)  # -> Points, Tangents, Parameters
divide_10 = DivideCurve(Curve=ln_2, Count=multiplication_3, Kinks=False)  # -> Points, Tangents, Parameters
flip_2 = FlipMatrix(Data=divide_6.Points)
flip_3 = FlipMatrix(Data=divide_7.Points)
cull = CullPattern(List=divide_8.Points, CullPattern=[False, True])
intcrv = Interpolate(Vertices=flip, Degree=3, Periodic=False, KnotStyle=1)  # -> Curve, Length, Domain
cull_2 = CullPattern(List=divide_9.Points, CullPattern=[False, True])
cull_3 = CullPattern(List=divide_10.Points, CullPattern=[False, True])
intcrv_2 = Interpolate(Vertices=flip_2, Degree=3, Periodic=False, KnotStyle=1)  # -> Curve, Length, Domain
intcrv_3 = Interpolate(Vertices=flip_3, Degree=3, Periodic=False, KnotStyle=1)  # -> Curve, Length, Domain
flip_4 = FlipMatrix(Data=cull)
flip_5 = FlipMatrix(Data=cull_2)
flip_6 = FlipMatrix(Data=cull_3)
intcrv_4 = Interpolate(Vertices=flip_4, Degree=3, Periodic=False, KnotStyle=1)  # -> Curve, Length, Domain
intcrv_5 = Interpolate(Vertices=flip_5, Degree=3, Periodic=False, KnotStyle=1)  # -> Curve, Length, Domain
intcrv_6 = Interpolate(Vertices=flip_6, Degree=3, Periodic=False, KnotStyle=1)  # -> Curve, Length, Domain
end = EndPoints(Curve=intcrv_4.Curve)  # -> Start, simplify(End)
divlength = DivideLength(Curve=intcrv_4.Curve, Length=distance_between_points)  # -> simplify(Points), Tangents, Parameters
divlength_2 = DivideLength(Curve=intcrv_5.Curve, Length=distance_between_points)  # -> simplify(Points), Tangents, Parameters
end_2 = EndPoints(Curve=intcrv_5.Curve)  # -> Start, simplify(End)
divlength_3 = DivideLength(Curve=intcrv_6.Curve, Length=distance_between_points)  # -> simplify(Points), Tangents, Parameters
end_3 = EndPoints(Curve=intcrv_6.Curve)  # -> Start, simplify(End)
merge = Merge(Data1=divlength.Points, Data2=end.End)
divlength_4 = DivideLength(Curve=intcrv.Curve, Length=distance_between_points)  # -> simplify(Points), Tangents, Parameters
merge_2 = Merge(Data1=divlength_2.Points, Data2=end_2.End)
merge_3 = Merge(Data1=divlength_3.Points, Data2=end_3.End)
flip_7 = FlipMatrix(Data=merge)  # -> flatten(Data)
flatten = FlattenTree(Data=divlength_4.Points, Path="{0}")
flip_8 = FlipMatrix(Data=merge_2)  # -> flatten(Data)
flip_9 = FlipMatrix(Data=merge_3)  # -> flatten(Data)
clean = CleanTree(Data=flip_7, CleanInvalid=True, CleanEmpty=False)
divlength_5 = DivideLength(Curve=intcrv_2.Curve, Length=distance_between_points)  # -> simplify(Points), Tangents, Parameters
divlength_6 = DivideLength(Curve=intcrv_3.Curve, Length=distance_between_points)  # -> simplify(Points), Tangents, Parameters
clean_2 = CleanTree(Data=flip_8, CleanInvalid=True, CleanEmpty=False)
clean_3 = CleanTree(Data=flip_9, CleanInvalid=True, CleanEmpty=False)
flatten_2 = FlattenTree(Data=divlength_5.Points, Path="{0}")
flatten_3 = FlattenTree(Data=divlength_6.Points, Path="{0}")
cps = ClosestPoints(Point=clean, Cloud=flatten, Count=1)  # -> ClosestPoint, CPIndex, Distance
cps_2 = ClosestPoints(Point=clean_2, Cloud=flatten_2, Count=1)  # -> ClosestPoint, CPIndex, Distance
cps_3 = ClosestPoints(Point=clean_3, Cloud=flatten_3, Count=1)  # -> ClosestPoint, CPIndex, Distance
dist = Distance(PointA=flatten(cps.ClosestPoint), PointB=clean)
dist_2 = Distance(PointA=flatten(cps_2.ClosestPoint), PointB=clean_2)
dist_3 = Distance(PointA=flatten(cps_3.ClosestPoint), PointB=clean_3)
sort = SortList(Keys=dist)  # -> Keys, ValuesA
Z = UnitZ(Factor=dist)
sort_2 = SortList(Keys=dist_2)  # -> Keys, ValuesA
sort_3 = SortList(Keys=dist_3)  # -> Keys, ValuesA
rev = ReverseList(List=sort.Keys)
Z_2 = UnitZ(Factor=dist_2)
Z_3 = UnitZ(Factor=dist_3)
neg = Negative(Value=Z)
rev_2 = ReverseList(List=sort_2.Keys)
rev_3 = ReverseList(List=sort_3.Keys)
item = ListItem(List=flatten(rev), Index=0, Wrap=False)
neg_2 = Negative(Value=Z_2)
neg_3 = Negative(Value=Z_3)
move = Move(Geometry=clean, Motion=neg)  # -> Geometry, Transform
item_2 = ListItem(List=flatten(rev_2), Index=0, Wrap=False)
item_3 = ListItem(List=flatten(rev_3), Index=0, Wrap=False)
move_2 = Move(Geometry=clean_2, Motion=neg_2)  # -> Geometry, Transform
move_3 = Move(Geometry=clean_3, Motion=neg_3)  # -> Geometry, Transform
smallest_distance = Panel([item, item_2, item_3])
series = Series(Start=0, Step=1, Count=amount_of_curves_as_transition)  # -> graft(Series)
series_2 = Series(Start=0, Step=1, Count=amount_of_curves_as_transition)  # -> graft(Series)
series_3 = Series(Start=0, Step=1, Count=amount_of_curves_as_transition)  # -> graft(Series)
lng = ListLength(List=merge_2)
lng_2 = ListLength(List=merge_3)
lng_3 = ListLength(List=merge)
flatten_4 = FlattenTree(Data=move_2.Geometry, Path="{0}")
flatten_5 = FlattenTree(Data=move_3.Geometry, Path="{0}")
flatten_6 = FlattenTree(Data=move.Geometry, Path="{0}")
dup = DuplicateData(Data=series, Number=lng, Order=True)
dup_2 = DuplicateData(Data=series_2, Number=lng_2, Order=True)
dup_3 = DuplicateData(Data=series_3, Number=lng_3, Order=True)
flip_10 = FlipMatrix(Data=dup)  # -> flatten(Data)
flip_11 = FlipMatrix(Data=dup_2)  # -> flatten(Data)
flip_12 = FlipMatrix(Data=dup_3)  # -> flatten(Data)
lng_4 = ListLength(List=flatten_4)
lng_5 = ListLength(List=flatten_5)
lng_6 = ListLength(List=flatten_6)
graft = GraftTree(Data=flatten_4, IncludeNullItems=True, IncludeEmptyLists=True)
series_4 = Series(Start=0, Step=1, Count=lng_4)
graft_2 = GraftTree(Data=flatten_5, IncludeNullItems=True, IncludeEmptyLists=True)
series_5 = Series(Start=0, Step=1, Count=lng_5)
graft_3 = GraftTree(Data=flatten_6, IncludeNullItems=True, IncludeEmptyLists=True)
series_6 = Series(Start=0, Step=1, Count=lng_6)
clean_4 = CleanTree(Data=flip_10, CleanInvalid=True, CleanEmpty=False)
clean_5 = CleanTree(Data=flip_11, CleanInvalid=True, CleanEmpty=False)
clean_6 = CleanTree(Data=flip_12, CleanInvalid=True, CleanEmpty=False)
simplify = SimplifyTree(Tree=graft, Front=False)
eval = Evaluate(F="\"{\"&x&\"}\"", x=clean_4)
simplify_2 = SimplifyTree(Tree=graft_2, Front=False)
eval_2 = Evaluate(F="\"{\"&x&\"}\"", x=clean_5)
simplify_3 = SimplifyTree(Tree=graft_3, Front=False)
eval_3 = Evaluate(F="\"{\"&x&\"}\"", x=clean_6)
int = Integer(series_4)
int_2 = Integer(series_5)
int_3 = Integer(series_6)
replace = ReplaceBranches(Data=simplify, Search=int, Replace=eval)
replace_2 = ReplaceBranches(Data=simplify_2, Search=int_2, Replace=eval_2)
replace_3 = ReplaceBranches(Data=simplify_3, Search=int_3, Replace=eval_3)
intcrv_7 = Interpolate(Vertices=replace, Degree=3, Periodic=False, KnotStyle=1)  # -> flatten(Curve), Length, Domain
intcrv_8 = Interpolate(Vertices=replace_2, Degree=3, Periodic=False, KnotStyle=1)  # -> flatten(Curve), Length, Domain
intcrv_9 = Interpolate(Vertices=replace_3, Degree=3, Periodic=False, KnotStyle=1)  # -> flatten(Curve), Length, Domain
flatten_7 = FlattenTree(Data=lng_3, Path="{0}")
flatten_8 = FlattenTree(Data=lng_2, Path="{0}")
flatten_9 = FlattenTree(Data=lng, Path="{0}")
flatten_10 = FlattenTree(Data=lng_3, Path="{0}")
shift = ShiftList(List=flatten(intcrv_2.Curve), Shift=1, Wrap=False)
shift_2 = ShiftList(List=flatten(intcrv_3.Curve), Shift=1, Wrap=False)
shift_3 = ShiftList(List=flatten(intcrv.Curve), Shift=1, Wrap=False)
avr = Average(Input=flatten_7)
avr_2 = Average(Input=flatten_8)
avr_3 = Average(Input=flatten_9)
avr_4 = Average(Input=flatten_10)
shift_4 = ShiftList(List=shift, Shift=-1, Wrap=False)
shift_5 = ShiftList(List=shift_2, Shift=-1, Wrap=False)
shift_6 = ShiftList(List=shift_3, Shift=-1, Wrap=False)
round = Round(Number=avr)  # -> Nearest, Floor, Ceiling
round_2 = Round(Number=avr_2)  # -> Nearest, Floor, Ceiling
round_3 = Round(Number=avr_3)  # -> Nearest, Floor, Ceiling
round_4 = Round(Number=avr_4)  # -> Nearest, Floor, Ceiling
crv_5 = Curve(crv)
crv_6 = Curve(intcrv_7.Curve)
crv_7 = Curve(shift_4)
crv_8 = Curve(intcrv_9.Curve)
crv_9 = Curve(shift_6)
crv_10 = Curve(intcrv_8.Curve)
crv_11 = Curve(shift_5)
crv_12 = Curve(crv_2)
crv_13 = Curve(crv_3)
crv_14 = Curve(crv_4)
divide_11 = DivideCurve(Curve=crv_5, Count=round_4.Nearest, Kinks=False)  # -> Points, Tangents, Parameters
divide_12 = DivideCurve(Curve=crv_12, Count=round.Nearest, Kinks=False)  # -> Points, Tangents, Parameters
divide_13 = DivideCurve(Curve=crv_13, Count=round_2.Nearest, Kinks=False)  # -> Points, Tangents, Parameters
weave = Weave(Pattern=[0, 1], Stream0=crv_6, Stream1=crv_7, NullGaps=False)
divide_14 = DivideCurve(Curve=crv_14, Count=round_3.Nearest, Kinks=False)  # -> Points, Tangents, Parameters
weave_2 = Weave(Pattern=[0, 1], Stream0=crv_10, Stream1=crv_11, NullGaps=False)
weave_3 = Weave(Pattern=[0, 1], Stream0=crv_8, Stream1=crv_9, NullGaps=False)
intcrv_10 = Interpolate(Vertices=divide_11.Points, Degree=3, Periodic=False, KnotStyle=1)  # -> Curve, Length, Domain
intcrv_11 = Interpolate(Vertices=divide_12.Points, Degree=3, Periodic=False, KnotStyle=1)  # -> Curve, Length, Domain
intcrv_12 = Interpolate(Vertices=divide_13.Points, Degree=3, Periodic=False, KnotStyle=1)  # -> Curve, Length, Domain
flatten_11 = FlattenTree(Data=weave, Path="{0}")
flatten_12 = FlattenTree(Data=weave_2, Path="{0}")
flatten_13 = FlattenTree(Data=weave_3, Path="{0}")
intcrv_13 = Interpolate(Vertices=divide_14.Points, Degree=3, Periodic=False, KnotStyle=1)  # -> Curve, Length, Domain
crv_15 = Curve(flatten(intcrv_10.Curve))
crv_16 = Curve(flatten(intcrv_11.Curve))
crv_17 = Curve(flatten(intcrv_13.Curve))
crv_18 = Curve(flatten(intcrv_12.Curve))
crv_19 = Curve(flatten_11)
crv_20 = Curve(flatten_12)
crv_21 = Curve(flatten_13)
merge_4 = Merge(Data1=crv_15, Data2=crv_21, Data3=crv_16, Data4=crv_19, Data5=crv_17, Data6=crv_20, Data7=crv_18)  # -> flatten(Result)
loft_opt = LoftOptions(Closed=False, Adjust=False, Rebuild=0, Refit=0, Type=Slider(3, range=0..10))
loft = Loft(Curves=merge_4, Options=loft_opt)
