# Grasshopper definition 150206 Curve lines to gcode shopbot.gh (Grasshopper 0.9.14)

move_speed_mm_s = Slider(35, range=0..100)
milling_bit_diameter = Slider(6, range=1..10)
plunge_rate_mm_s = Slider(20, range=0..100)
spindle_speed = Slider(18000, range=6000..18000)
tolerance = Slider(0, range=0..1)
safe_z_height = Slider(6, range=0..20)

# ---- group: ZERO point
safe_z_home_above_safe_z_height = Slider(14, range=0..20)
x_direction = Slider(0, range=0..100)
y_direction = Slider(0, range=0..100)
addition = Addition(A=safe_z_home_above_safe_z_height, B=safe_z_height)
pt = PointXYZ(XComponent=x_direction, YComponent=y_direction, ZComponent=addition, System=PlaneXY(0, 0, 0))

# ----
list = ValueList({"Preview ON": True, "Preview OFF": False}, selected=[], ListIndex=0, UIMode=1)
list_2 = ValueList({"MM": 0, "Inch": 1}, selected=[], ListIndex=0, UIMode=1)
gate = StreamGate(Stream=plunge_rate_mm_s, Gate=list_2)  # -> Target0, Target1
gate_2 = StreamGate(Stream=move_speed_mm_s, Gate=list_2)  # -> Target0, Target1
division = Division(A=gate_2.Target1, B="25.4")
division_2 = Division(A=gate.Target1, B="25.4")
crv = Curve(<curve referenced from the Rhino model>)
crv_2 = Curve(<curve referenced from the Rhino model>)
crv_3 = Curve(<curve referenced from the Rhino model>)
crv_4 = Curve(<curve referenced from the Rhino model>)
amount_of_curves_as_transition = Slider(7, range=0..10)
divide = DivideCurve(Curve=crv, Count="40", Kinks=False)  # -> Points, Tangents, Parameters
divide_2 = DivideCurve(Curve=crv_2, Count="40", Kinks=False)  # -> Points, Tangents, Parameters
divide_3 = DivideCurve(Curve=crv_4, Count="40", Kinks=False)  # -> Points, Tangents, Parameters
divide_4 = DivideCurve(Curve=crv_3, Count="40", Kinks=False)  # -> Points, Tangents, Parameters
ln = Line(StartPoint=divide.Points, EndPoint=divide_2.Points)
ln_2 = Line(StartPoint=divide_2.Points, EndPoint=divide_3.Points)
ln_3 = Line(StartPoint=divide_3.Points, EndPoint=divide_4.Points)
divide_5 = DivideCurve(Curve=ln, Count=amount_of_curves_as_transition, Kinks=False)  # -> Points, Tangents, Parameters
divide_6 = DivideCurve(Curve=ln_2, Count=amount_of_curves_as_transition, Kinks=False)  # -> Points, Tangents, Parameters
divide_7 = DivideCurve(Curve=ln_3, Count=amount_of_curves_as_transition, Kinks=False)  # -> Points, Tangents, Parameters
multiplication = Multiplication(A=amount_of_curves_as_transition, B="2")
multiplication_2 = Multiplication(A=amount_of_curves_as_transition, B="2")
multiplication_3 = Multiplication(A=amount_of_curves_as_transition, B="2")
distance_between_points = Slider(0.25, range=0.01..2)
flip = FlipMatrix(Data=divide_5.Points)
flip_2 = FlipMatrix(Data=divide_6.Points)
flip_3 = FlipMatrix(Data=divide_7.Points)
divide_8 = DivideCurve(Curve=ln, Count=multiplication, Kinks=False)  # -> Points, Tangents, Parameters
divide_9 = DivideCurve(Curve=ln_2, Count=multiplication_2, Kinks=False)  # -> Points, Tangents, Parameters
divide_10 = DivideCurve(Curve=ln_3, Count=multiplication_3, Kinks=False)  # -> Points, Tangents, Parameters
intcrv = Interpolate(Vertices=flip, Degree=3, Periodic=False, KnotStyle=1)  # -> Curve, Length, Domain
intcrv_2 = Interpolate(Vertices=flip_2, Degree=3, Periodic=False, KnotStyle=1)  # -> Curve, Length, Domain
intcrv_3 = Interpolate(Vertices=flip_3, Degree=3, Periodic=False, KnotStyle=1)  # -> Curve, Length, Domain
cull = CullPattern(List=divide_8.Points, CullPattern=[False, True])
cull_2 = CullPattern(List=divide_9.Points, CullPattern=[False, True])
cull_3 = CullPattern(List=divide_10.Points, CullPattern=[False, True])
flip_4 = FlipMatrix(Data=cull)
flip_5 = FlipMatrix(Data=cull_2)
flip_6 = FlipMatrix(Data=cull_3)
intcrv_4 = Interpolate(Vertices=flip_4, Degree=3, Periodic=False, KnotStyle=1)  # -> Curve, Length, Domain
intcrv_5 = Interpolate(Vertices=flip_5, Degree=3, Periodic=False, KnotStyle=1)  # -> Curve, Length, Domain
intcrv_6 = Interpolate(Vertices=flip_6, Degree=3, Periodic=False, KnotStyle=1)  # -> Curve, Length, Domain
divlength = DivideLength(Curve=intcrv_4.Curve, Length=distance_between_points)  # -> simplify(Points), Tangents, Parameters
divlength_2 = DivideLength(Curve=intcrv_5.Curve, Length=distance_between_points)  # -> simplify(Points), Tangents, Parameters
divlength_3 = DivideLength(Curve=intcrv_6.Curve, Length=distance_between_points)  # -> simplify(Points), Tangents, Parameters
end = EndPoints(Curve=intcrv_4.Curve)  # -> Start, simplify(End)
end_2 = EndPoints(Curve=intcrv_5.Curve)  # -> Start, simplify(End)
end_3 = EndPoints(Curve=intcrv_6.Curve)  # -> Start, simplify(End)
merge = Merge(Data1=divlength.Points, Data2=end.End)
divlength_4 = DivideLength(Curve=intcrv.Curve, Length=distance_between_points)  # -> simplify(Points), Tangents, Parameters
merge_2 = Merge(Data1=divlength_2.Points, Data2=end_2.End)
merge_3 = Merge(Data1=divlength_3.Points, Data2=end_3.End)
flip_7 = FlipMatrix(Data=merge)  # -> flatten(Data)
flatten = FlattenTree(Data=divlength_4.Points, Path="{0}")
flip_8 = FlipMatrix(Data=merge_2)  # -> flatten(Data)
flip_9 = FlipMatrix(Data=merge_3)  # -> flatten(Data)
clean = CleanTree(Data=flip_7, CleanInvalid=True, CleanEmpty=False)
divlength_5 = DivideLength(Curve=intcrv_2.Curve, Length=distance_between_points)  # -> simplify(Points), Tangents, Parameters
divlength_6 = DivideLength(Curve=intcrv_3.Curve, Length=distance_between_points)  # -> simplify(Points), Tangents, Parameters
clean_2 = CleanTree(Data=flip_8, CleanInvalid=True, CleanEmpty=False)
clean_3 = CleanTree(Data=flip_9, CleanInvalid=True, CleanEmpty=False)
flatten_2 = FlattenTree(Data=divlength_5.Points, Path="{0}")
flatten_3 = FlattenTree(Data=divlength_6.Points, Path="{0}")
cps = ClosestPoints(Point=clean, Cloud=flatten, Count=1)  # -> ClosestPoint, CPIndex, Distance
cps_2 = ClosestPoints(Point=clean_2, Cloud=flatten_2, Count=1)  # -> ClosestPoint, CPIndex, Distance
cps_3 = ClosestPoints(Point=clean_3, Cloud=flatten_3, Count=1)  # -> ClosestPoint, CPIndex, Distance
dist = Distance(PointA=flatten(cps.ClosestPoint), PointB=clean)
dist_2 = Distance(PointA=flatten(cps_2.ClosestPoint), PointB=clean_2)
dist_3 = Distance(PointA=flatten(cps_3.ClosestPoint), PointB=clean_3)
Z = UnitZ(Factor=dist)
Z_2 = UnitZ(Factor=dist_2)
Z_3 = UnitZ(Factor=dist_3)
neg = Negative(Value=Z_2)
neg_2 = Negative(Value=Z)
neg_3 = Negative(Value=Z_3)
move = Move(Geometry=clean, Motion=neg_2)  # -> Geometry, Transform
move_2 = Move(Geometry=clean_2, Motion=neg)  # -> Geometry, Transform
move_3 = Move(Geometry=clean_3, Motion=neg_3)  # -> Geometry, Transform
int = Integer(amount_of_curves_as_transition)
sort = SortList(Keys=dist)  # -> Keys, ValuesA
sort_2 = SortList(Keys=dist_2)  # -> Keys, ValuesA
sort_3 = SortList(Keys=dist_3)  # -> Keys, ValuesA
rev = ReverseList(List=sort.Keys)
rev_2 = ReverseList(List=sort_2.Keys)
rev_3 = ReverseList(List=sort_3.Keys)
shift = ShiftList(List=flatten(intcrv_2.Curve), Shift=1, Wrap=False)
shift_2 = ShiftList(List=flatten(intcrv_3.Curve), Shift=1, Wrap=False)
shift_3 = ShiftList(List=flatten(intcrv.Curve), Shift=1, Wrap=False)
series = Series(Start=0, Step=1, Count=int)  # -> graft(Series)
series_2 = Series(Start=0, Step=1, Count=int)  # -> graft(Series)
series_3 = Series(Start=0, Step=1, Count=int)  # -> graft(Series)
flatten_4 = FlattenTree(Data=move.Geometry, Path="{0}")
flatten_5 = FlattenTree(Data=move_2.Geometry, Path="{0}")
flatten_6 = FlattenTree(Data=move_3.Geometry, Path="{0}")
lng = ListLength(List=merge)
flatten_7 = FlattenTree(Data=lng, Path="{0}")
flatten_8 = FlattenTree(Data=lng, Path="{0}")
avr = Average(Input=flatten_7)
avr_2 = Average(Input=flatten_8)
lng_2 = ListLength(List=merge_2)
flatten_9 = FlattenTree(Data=lng_2, Path="{0}")
avr_3 = Average(Input=flatten_9)
lng_3 = ListLength(List=merge_3)
flatten_10 = FlattenTree(Data=lng_3, Path="{0}")
avr_4 = Average(Input=flatten_10)
item = ListItem(List=flatten(rev), Index=0, Wrap=False)
item_2 = ListItem(List=flatten(rev_2), Index=0, Wrap=False)
item_3 = ListItem(List=flatten(rev_3), Index=0, Wrap=False)
shift_4 = ShiftList(List=shift, Shift=-1, Wrap=False)
shift_5 = ShiftList(List=shift_2, Shift=-1, Wrap=False)
shift_6 = ShiftList(List=shift_3, Shift=-1, Wrap=False)
round = Round(Number=avr)  # -> Nearest, Floor, Ceiling
round_2 = Round(Number=avr_4)  # -> Nearest, Floor, Ceiling
round_3 = Round(Number=avr_3)  # -> Nearest, Floor, Ceiling
round_4 = Round(Number=avr_2)  # -> Nearest, Floor, Ceiling
dup = DuplicateData(Data=series, Number=lng, Order=True)
dup_2 = DuplicateData(Data=series_2, Number=lng_2, Order=True)
dup_3 = DuplicateData(Data=series_3, Number=lng_3, Order=True)
crv_5 = Curve(crv)
crv_6 = Curve(shift_4)
crv_7 = Curve(shift_5)
crv_8 = Curve(shift_6)
crv_9 = Curve(crv_2)
crv_10 = Curve(crv_3)
crv_11 = Curve(crv_4)
biggest_depth = Panel([item, item_2, item_3])
divide_11 = DivideCurve(Curve=crv_5, Count=round_4.Nearest, Kinks=False)  # -> Points, Tangents, Parameters
flip_10 = FlipMatrix(Data=dup)  # -> flatten(Data)
flip_11 = FlipMatrix(Data=dup_2)  # -> flatten(Data)
flip_12 = FlipMatrix(Data=dup_3)  # -> flatten(Data)
divide_12 = DivideCurve(Curve=crv_9, Count=round.Nearest, Kinks=False)  # -> Points, Tangents, Parameters
divide_13 = DivideCurve(Curve=crv_10, Count=round_2.Nearest, Kinks=False)  # -> Points, Tangents, Parameters
divide_14 = DivideCurve(Curve=crv_11, Count=round_3.Nearest, Kinks=False)  # -> Points, Tangents, Parameters
lng_4 = ListLength(List=flatten_4)
lng_5 = ListLength(List=flatten_5)
lng_6 = ListLength(List=flatten_6)
intcrv_7 = Interpolate(Vertices=divide_11.Points, Degree=3, Periodic=False, KnotStyle=1)  # -> Curve, Length, Domain
intcrv_8 = Interpolate(Vertices=divide_12.Points, Degree=3, Periodic=False, KnotStyle=1)  # -> Curve, Length, Domain
intcrv_9 = Interpolate(Vertices=divide_13.Points, Degree=3, Periodic=False, KnotStyle=1)  # -> Curve, Length, Domain
clean_4 = CleanTree(Data=flip_10, CleanInvalid=True, CleanEmpty=False)
clean_5 = CleanTree(Data=flip_11, CleanInvalid=True, CleanEmpty=False)
clean_6 = CleanTree(Data=flip_12, CleanInvalid=True, CleanEmpty=False)
intcrv_10 = Interpolate(Vertices=divide_14.Points, Degree=3, Periodic=False, KnotStyle=1)  # -> Curve, Length, Domain
graft = GraftTree(Data=flatten_4, IncludeNullItems=True, IncludeEmptyLists=True)
series_4 = Series(Start=0, Step=1, Count=lng_4)
graft_2 = GraftTree(Data=flatten_5, IncludeNullItems=True, IncludeEmptyLists=True)
series_5 = Series(Start=0, Step=1, Count=lng_5)
graft_3 = GraftTree(Data=flatten_6, IncludeNullItems=True, IncludeEmptyLists=True)
series_6 = Series(Start=0, Step=1, Count=lng_6)
simplify = SimplifyTree(Tree=graft, Front=False)
simplify_2 = SimplifyTree(Tree=graft_2, Front=False)
simplify_3 = SimplifyTree(Tree=graft_3, Front=False)
eval = Evaluate(F="\"{\"&x&\"}\"", x=clean_4)
eval_2 = Evaluate(F="\"{\"&x&\"}\"", x=clean_5)
eval_3 = Evaluate(F="\"{\"&x&\"}\"", x=clean_6)
int_2 = Integer(series_4)
int_3 = Integer(series_5)
int_4 = Integer(series_6)
replace = ReplaceBranches(Data=simplify_2, Search=int_3, Replace=eval_2)
intcrv_11 = Interpolate(Vertices=replace, Degree=3, Periodic=False, KnotStyle=1)  # -> flatten(Curve), Length, Domain
crv_12 = Curve(intcrv_11.Curve)
weave = Weave(Pattern=[0, 1], Stream0=crv_12, Stream1=crv_6, NullGaps=False)
flatten_11 = FlattenTree(Data=weave, Path="{0}")
replace_2 = ReplaceBranches(Data=simplify_3, Search=int_4, Replace=eval_3)
intcrv_12 = Interpolate(Vertices=replace_2, Degree=3, Periodic=False, KnotStyle=1)  # -> flatten(Curve), Length, Domain
crv_13 = Curve(intcrv_12.Curve)
weave_2 = Weave(Pattern=[0, 1], Stream0=crv_13, Stream1=crv_7, NullGaps=False)
flatten_12 = FlattenTree(Data=weave_2, Path="{0}")
replace_3 = ReplaceBranches(Data=simplify, Search=int_2, Replace=eval)
intcrv_13 = Interpolate(Vertices=replace_3, Degree=3, Periodic=False, KnotStyle=1)  # -> flatten(Curve), Length, Domain
crv_14 = Curve(intcrv_13.Curve)
weave_3 = Weave(Pattern=[0, 1], Stream0=crv_14, Stream1=crv_8, NullGaps=False)
flatten_13 = FlattenTree(Data=weave_3, Path="{0}")
crv_15 = Curve(flatten(intcrv_7.Curve))
crv_16 = Curve(flatten(intcrv_8.Curve))
crv_17 = Curve(flatten(intcrv_10.Curve))
crv_18 = Curve(flatten(intcrv_9.Curve))
crv_19 = Curve(flatten_11)
crv_20 = Curve(flatten_13)
crv_21 = Curve(flatten_12)
merge_4 = Merge(Data1=crv_15, Data2=crv_20, Data3=crv_16, Data4=crv_19, Data5=crv_17, Data6=crv_21, Data7=crv_18)  # -> flatten(Result)
flip_13 = FlipMatrix(Data=replace_3)
flip_14 = FlipMatrix(Data=replace)
flip_15 = FlipMatrix(Data=replace_2)
cull_4 = CullPattern(List=flip_13, CullPattern=invert([False, True]))
cull_5 = CullPattern(List=flip_14, CullPattern=invert([False, True]))
cull_6 = CullPattern(List=flip_15, CullPattern=invert([False, True]))
cull_7 = CullPattern(List=flip_13, CullPattern=[False, True])
cull_8 = CullPattern(List=flip_14, CullPattern=[False, True])
cull_9 = CullPattern(List=flip_15, CullPattern=[False, True])
flip_16 = FlipMatrix(Data=cull_4)
flip_17 = FlipMatrix(Data=cull_8)
flip_18 = FlipMatrix(Data=cull_6)
loft_opt = LoftOptions(Closed=False, Adjust=False, Rebuild=0, Refit=0, Type=Slider(3, range=0..10))
rev_4 = ReverseList(List=flip_16)
rev_5 = ReverseList(List=flip_17)
rev_6 = ReverseList(List=flip_18)
loft = Loft(Curves=merge_4, Options=loft_opt)
flip_19 = FlipMatrix(Data=rev_4)
flip_20 = FlipMatrix(Data=rev_5)
flip_21 = FlipMatrix(Data=rev_6)
preview = CustomPreview(Geometry=loft, Shader=ColourSwatch(SwatchColor=RGB(101, 150, 60)))
weave_4 = Weave(Pattern=[0, 1], Stream0=flip_19, Stream1=cull_7, NullGaps=False)
weave_5 = Weave(Pattern=[0, 1], Stream0=cull_5, Stream1=flip_20, NullGaps=False)
weave_6 = Weave(Pattern=[0, 1], Stream0=flip_21, Stream1=cull_9, NullGaps=False)
flip_22 = FlipMatrix(Data=weave_4)
flip_23 = FlipMatrix(Data=weave_5)
flip_24 = FlipMatrix(Data=weave_6)
clean_7 = CleanTree(Data=flip_22, CleanInvalid=True, CleanEmpty=True)
clean_8 = CleanTree(Data=flip_23, CleanInvalid=True, CleanEmpty=True)
clean_9 = CleanTree(Data=flip_24, CleanInvalid=True, CleanEmpty=True)
group = Group(Objects=clean_7)
group_2 = Group(Objects=clean_8)
group_3 = Group(Objects=clean_9)
merge_5 = Merge(Data1=group, Data2=group_2, Data3=group_3)
flip_25 = FlipMatrix(Data=merge_5)
ungroup = Ungroup(Group=flip_25)
item_4 = ListItem(List=ungroup, Index="0", Wrap=False)
pcomp = Decompose(Point=item_4, System=PlaneXY(0, 0, 0))  # -> XComponent, YComponent, ZComponent
pt_2 = PointXYZ(XComponent=pcomp.XComponent, YComponent=pcomp.YComponent, ZComponent=0, System=PlaneXY(0, 0, 0))
replace_4 = ListReplace(List=ungroup, Item=pt_2, Indices="0", Wrap=False)
lng_7 = ListLength(List=replace_4)
subtraction = Subtraction(A=lng_7, B="1")
item_5 = ListItem(List=replace_4, Index=subtraction, Wrap=False)
pcomp_2 = Decompose(Point=item_5, System=PlaneXY(0, 0, 0))  # -> XComponent, YComponent, ZComponent
pt_3 = PointXYZ(XComponent=pcomp_2.XComponent, YComponent=pcomp_2.YComponent, ZComponent=0, System=PlaneXY(0, 0, 0))
replace_5 = ListReplace(List=replace_4, Item=pt_3, Indices=subtraction, Wrap=False)
home = Point(pt)
pt_4 = Point(replace_5)
item_6 = ListItem(List=pt_4, Index=0, Wrap=False)

# ---- group: Safe Z points
pt_5 = Point(item_6)
lng_8 = ListLength(List=pt_4)
subtraction_2 = Subtraction(A=lng_8, B="1")
num = Number(safe_z_height)
Z_4 = UnitZ(Factor=num)
item_7 = ListItem(List=pt_4, Index=subtraction_2, Wrap=False)
num_2 = Number(safe_z_height)
move_4 = Move(Geometry=pt_5, Motion=Z_4)  # -> Geometry, Transform
Z_5 = UnitZ(Factor=num_2)
pt_6 = Point(item_7)
move_5 = Move(Geometry=pt_6, Motion=Z_5)  # -> Geometry, Transform
pt_7 = Point([home, move_4.Geometry])
flatten_14 = FlattenTree(Data=move_5.Geometry, Path="{0}")
flatten_15 = FlattenTree(Data=pt_7, Path="{0}")
graft_4 = GraftTree(Data=flatten_14, IncludeNullItems=True, IncludeEmptyLists=True)
graft_5 = GraftTree(Data=flatten_15, IncludeNullItems=True, IncludeEmptyLists=True)

# ---- group: Shift list order to first point & regroup
lng_9 = ListLength(List=pt_4)  # -> flatten(Length)
flatten_16 = FlattenTree(Data=pt_4, Path="{0}")
ma = MassAddition(Input=lng_9)  # -> Result, PartialResults
lng_10 = ListLength(List=ma.PartialResults)
subtraction_3 = Subtraction(A=ma.PartialResults, B="1")
culln = CullNth(List=ma.PartialResults, CullFrequency=lng_10)  # -> flatten(List)
int_5 = Integer(["0", culln])
dom = Domain(DomainStart=int_5, DomainEnd=subtraction_3)
subset = SubList(List=flatten_16, Domain=dom, Cycle=True)  # -> List, Index
simplify_4 = SimplifyTree(Tree=subset.List, Front=False)

# ---- group: Remove start & endpoint from list & regroup
pt_8 = Point([graft_5, graft_4])
flatten_17 = FlattenTree(Data=pt_8, Path="{0}")
lng_11 = ListLength(List=flatten_17)
division_3 = Division(A=lng_11, B="2")
round_5 = Round(Number=division_3)  # -> Nearest, Floor, Ceiling
series_7 = Series(Start=0, Step=1, Count=round_5.Ceiling)
graft_6 = GraftTree(Data=flatten_17, IncludeNullItems=True, IncludeEmptyLists=True)
lng_12 = ListLength(List=flatten_17)
simplify_5 = SimplifyTree(Tree=graft_6, Front=False)
dup_4 = DuplicateData(Data=series_7, Number="2", Order=Toggle(False))
flatten_18 = FlattenTree(Data=simplify_5, Path="{0}")
subtraction_4 = Subtraction(A=lng_12, B="1")
lng_13 = ListLength(List=flatten_17)
int_6 = Integer("0")
cull_i = CullIndex(List=flatten_18, Indices=int_6, Wrap=False)  # -> flatten(List)
series_8 = Series(Start=0, Step=1, Count=lng_11)
subtraction_5 = Subtraction(A=lng_13, B="1")
eval_4 = Evaluate(F="\"{\"&x&\"}\"", x=dup_4)
split = SplitList(List=eval_4, Index=lng_11)  # -> ListA, ListB
flatten_19 = FlattenTree(Data=split.ListA, Path="{0}")
int_7 = Integer(series_8)
int_8 = Integer(subtraction_5)
cull_i_2 = CullIndex(List=int_7, Indices=int_8, Wrap=False)
graft_7 = GraftTree(Data=cull_i, IncludeNullItems=True, IncludeEmptyLists=True)
simplify_6 = SimplifyTree(Tree=graft_7, Front=False)
pshift = ShiftPaths(Data=cull_i_2, Offset=-1)
cull_i_3 = CullIndex(List=flatten_19, Indices=int_6, Wrap=False)
replace_6 = ReplaceBranches(Data=simplify_6, Search=pshift, Replace=cull_i_3)

# ---- group: Reverse list for clockwise milling
rev_7 = ReverseList(List=simplify_4)

# ---- group: Group paths
group_4 = Group(Objects=rev_7)
flatten_20 = FlattenTree(Data=group_4, Path="{0}")
lng_14 = ListLength(List=pt_4)
lng_15 = ListLength(List=flatten_20)
division_4 = Division(A=lng_15, B=lng_14)
round_6 = Round(Number=division_4)  # -> Nearest, Floor, Ceiling
series_9 = Series(Start=0, Step=1, Count=round_6.Ceiling)
graft_8 = GraftTree(Data=flatten_20, IncludeNullItems=True, IncludeEmptyLists=True)
series_10 = Series(Start=0, Step=1, Count=lng_15)
dup_5 = DuplicateData(Data=series_9, Number=lng_14, Order=Toggle(False))
simplify_7 = SimplifyTree(Tree=graft_8, Front=False)
int_9 = Integer(series_10)
eval_5 = Evaluate(F="\"{\"&x&\"}\"", x=dup_5)
split_2 = SplitList(List=eval_5, Index=lng_15)  # -> ListA, ListB
replace_7 = ReplaceBranches(Data=simplify_7, Search=int_9, Replace=split_2.ListA)
ungroup_2 = Ungroup(Group=replace_7)  # -> simplify(Objects)

# ----
panel = Panel("'Toolpath Name =")

pcomp_3 = Decompose(Point=home, System=PlaneXY(0, 0, 0))  # -> XComponent, YComponent, ZComponent
gate_3 = StreamGate(Stream=pcomp_3.ZComponent, Gate=0)  # -> Target0, Target1
division_5 = Division(A=gate_3.Target1, B="25.4")
num_3 = Number([gate_3.Target0, division_5])
join = StringJoin(Strings=["JZ,", num_3])

pcomp_4 = Decompose(Point=home, System=PlaneXY(0, 0, 0))  # -> XComponent, YComponent, ZComponent
gate_4 = StreamGate(Stream=pcomp_4.ZComponent, Gate=0)  # -> Target0, Target1
gate_5 = StreamGate(Stream=pcomp_4.XComponent, Gate=0)  # -> Target0, Target1
gate_6 = StreamGate(Stream=pcomp_4.YComponent, Gate=0)  # -> Target0, Target1
division_6 = Division(A=gate_4.Target1, B="25.4")
division_7 = Division(A=gate_5.Target1, B="25.4")
division_8 = Division(A=gate_6.Target1, B="25.4")
num_4 = Number([gate_6.Target0, division_8])
num_5 = Number([gate_4.Target0, division_6])
num_6 = Number([gate_5.Target0, division_7])
join_2 = StringJoin(Strings=["JZ,", num_5, "J2,", num_6, ",", num_4])

pcomp_5 = Decompose(Point=home, System=PlaneXY(0, 0, 0))  # -> XComponent, YComponent, ZComponent
num_7 = Number(pcomp_5.XComponent)
num_8 = Number(pcomp_5.YComponent)
join_3 = StringJoin(Strings=["J2,", num_7, ",", num_8])

pt_9 = Point([pt_5, pt_6])
rev_8 = ReverseList(List=pt_9)  # -> flatten(List)

# ---- group: Preview
div_list = DivideListIntoGroups(data=flatten_17, number=Slider(2, range=0..10))
geo = Geometry(flatten_17)
pline = PolyLine(Vertices=div_list, Closed=False)
shift_7 = ShiftList(List=geo, Shift=1, Wrap=False)
pline_2 = PolyLine(Vertices=ungroup_2, Closed=False)
ln_4 = Line(StartPoint=shift_7, EndPoint=rev_8)
cull_10 = CullPattern(List=pline, CullPattern=list)
cull_11 = CullPattern(List=ln_4, CullPattern=list)
cull_12 = CullPattern(List=pline_2, CullPattern=list)
preview_2 = CustomPreview(Geometry=cull_10, Shader=ColourSwatch(SwatchColor=RGB(255, 0, 0)))
preview_3 = CustomPreview(Geometry=cull_11, Shader=ColourSwatch(SwatchColor=RGB(38, 255, 0)))
preview_4 = CustomPreview(Geometry=cull_12, Shader=ColourSwatch(SwatchColor=RGB(0, 97, 224)))

# ----
num_9 = Number([gate_2.Target0, division])
num_10 = Number([gate.Target0, division_2])

join_4 = StringJoin(Strings=["MS,", num_9, ",", num_10])

panel_2 = Panel("""'SHOPBOT FILE IN mm
IF %(25)=0 THEN GOTO UNIT_ERROR	'check to see software is set to standard
C#,90				 	'Lookup offset values
'""")
panel_3 = Panel("""'SHOPBOT FILE IN INCHES
IF %(25)=1 THEN GOTO UNIT_ERROR	'check to see software is set to standard
C#,90				 	'Lookup offset values
'""")
panel_4 = Panel("""END
UNIT_ERROR:
C#,91					'Run file explaining unit error
END""")
panel_5 = Panel("""'
'Turning router OFF
SO,1,0""")

# ---- group: Spindle speed
int_10 = Integer(spindle_speed)
join_5 = StringJoin(Strings=["TR,", int_10, ",1"])

# ----
panel_6 = Panel("""'Turning router ON
SO,1,1
PAUSE 2
'
'Toolpath Name = from grasshopper
'Tool Name = bit""")
gate_7 = StreamGate(Stream=panel_2, Gate=list_2)  # -> Target0, Target1
gate_8 = StreamGate(Stream=panel_3, Gate=list_2)  # -> Target0, Target1

# ---- group: Add M3, , ; to every coordinate
merge_6 = Merge(Data1=replace_6, Data2=ungroup_2)
flatten_21 = FlattenTree(Data=merge_6, Path="{0}")
pcomp_6 = Decompose(Point=flatten_21, System=PlaneXY(0, 0, 0))  # -> XComponent, YComponent, ZComponent
lng_16 = ListLength(List=flatten_21)
dup_6 = DuplicateData(Data="M3,", Number=lng_16, Order=True)
dup_7 = DuplicateData(Data=",", Number=lng_16, Order=True)
dup_8 = DuplicateData(Data=",", Number=lng_16, Order=True)
flatten_22 = FlattenTree(Data=dup_7, Path="{0}")
flatten_23 = FlattenTree(Data=dup_8, Path="{0}")
graft_9 = GraftTree(Data=flatten_22, IncludeNullItems=True, IncludeEmptyLists=True)
graft_10 = GraftTree(Data=flatten_23, IncludeNullItems=True, IncludeEmptyLists=True)

# ----
num_11 = Number(pcomp_6.XComponent)
num_12 = Number(pcomp_6.YComponent)
num_13 = Number(pcomp_6.ZComponent)
gate_9 = StreamGate(Stream=num_12, Gate=list_2)  # -> Target0, Target1
gate_10 = StreamGate(Stream=num_11, Gate=list_2)  # -> Target0, Target1
gate_11 = StreamGate(Stream=num_13, Gate=list_2)  # -> Target0, Target1
division_9 = Division(A=gate_10.Target1, B="25.4")
division_10 = Division(A=gate_9.Target1, B="25.4")
division_11 = Division(A=gate_11.Target1, B="25.4")
larger = LargerThan(FirstNumber=num_13, SecondNumber=0)  # -> LargerThan, OrEqualTo
dup_9 = DuplicateData(Data="J3,", Number=lng_16, Order=True)
graft_11 = GraftTree(Data=dup_6, IncludeNullItems=True, IncludeEmptyLists=True)
graft_12 = GraftTree(Data=larger.LargerThan, IncludeNullItems=True, IncludeEmptyLists=True)
graft_13 = GraftTree(Data=larger.LargerThan, IncludeNullItems=True, IncludeEmptyLists=True)
graft_14 = GraftTree(Data=dup_9, IncludeNullItems=True, IncludeEmptyLists=True)
cull_13 = CullPattern(List=graft_11, CullPattern=invert(graft_12))
cull_14 = CullPattern(List=graft_14, CullPattern=graft_13)
merge_7 = Merge(Data1=cull_13, Data2=cull_14)

# ---- group: Add M3, , ; to every coordinate (continued)
flatten_24 = FlattenTree(Data=merge_7, Path="{0}")
simplify_8 = SimplifyTree(Tree=[gate_10.Target0, division_9], Front=False)
simplify_9 = SimplifyTree(Tree=[gate_9.Target0, division_10], Front=False)
simplify_10 = SimplifyTree(Tree=[gate_11.Target0, division_11], Front=False)
graft_15 = GraftTree(Data=flatten_24, IncludeNullItems=True, IncludeEmptyLists=True)
graft_16 = GraftTree(Data=simplify_8, IncludeNullItems=True, IncludeEmptyLists=True)
graft_17 = GraftTree(Data=simplify_9, IncludeNullItems=True, IncludeEmptyLists=True)
graft_18 = GraftTree(Data=simplify_10, IncludeNullItems=True, IncludeEmptyLists=True)
join_6 = StringJoin(Strings=[graft_15, graft_16, graft_9, graft_17, graft_10, graft_18])
flatten_25 = FlattenTree(Data=join_6, Path="{0}")

# ----
merge_8 = Merge(
    Data1=[gate_7.Target0, gate_8.Target1],
    Data2=join_5,
    Data3=panel_6,
    Data4=join_4,
    Data5=join_2,
    Data6=flatten_25,
    Data7=join,
    Data8=panel_5,
    Data9=join_3,
    Data10=panel_4)  # -> flatten(Result)
panel_7 = Panel(merge_8)

# ==== cluster DivideListIntoGroups: Divides data as a list into given number of groups
number = ClusterInput()  # Insert number for amount of groups
data = ClusterInput()  # Insert list as data
flatten = FlattenTree(Data=data, Path="{0}")
lng = ListLength(List=flatten)
division = Division(A=lng, B=number)
round = Round(Number=division)  # -> Nearest, Floor, Ceiling
series = Series(Start=0, Step=1, Count=round.Ceiling)
graft = GraftTree(Data=flatten, IncludeNullItems=True, IncludeEmptyLists=True)
series_2 = Series(Start=0, Step=1, Count=lng)
dup = DuplicateData(Data=series, Number=number, Order=Toggle(False))
simplify = SimplifyTree(Tree=graft, Front=False)
int = Integer(series_2)
eval = Evaluate(F="\"{\"&x&\"}\"", x=dup)
split = SplitList(List=eval, Index=lng)  # -> ListA, ListB
replace = ReplaceBranches(Data=simplify, Search=int, Replace=split.ListA)
D = ClusterOutput(replace)
